# Grasshopper definition sample_box_grasshopper2.gh (Grasshopper 1.0.8)
# plug-ins: ShapeDiverForGrasshopper

sddp = ShapeDiverDocumentPayload({AbsoluteTolerance=0, AngleTolerance=0, DistanceDisplayPrecision=0, GltfVersion="Gltf2", GrasshopperVersion="1.0.0008", InputGroups="{}", OutputGroups="{}", RelativeTolerance=0, RhinoVersion="8.12.24282.7001", UnitSystem=0, VersionCreated="1.21.0.0", VersionSaved="1.21.0.0"})
width = GetNumber(Slider(3, range=0..20), AtLeast=1, AtMost=1, Maximum=1.797693135e+308, Minimum=-1.797693135e+308, TreeAccess=False)
length = GetNumber(Slider(4, range=0..20), AtLeast=1, AtMost=1, Maximum=1.797693135e+308, Minimum=-1.797693135e+308, TreeAccess=False)
height = GetNumber(Slider(5, range=0..20), AtLeast=1, AtMost=1, Maximum=1.797693135e+308, Minimum=-1.797693135e+308, TreeAccess=False)
box = CenterBox(Base=PlaneXY(0, 0, 0), X=width, Y=length, Z=height)
mesh = Mesh(box)
mcol = MeshColours(Mesh=mesh, Colours=ColourSwatch(SwatchColor=RGB(0, 204, 255)))
context_bake = ContextBake(Geometry=mcol)
